# Grasshopper definition Flower.gh (Grasshopper 1.0.7)
# plug-ins: NPKG

r1 = Input()
default = SetDefault(Input=r1, Default="12")
r2 = Input()
cir = Circle(Plane=PlaneXY(0, 0, 0), Radius=default)
divide = DivideCurve(Curve=cir, Count=10, Kinks=False)  # -> Points, Tangents, Parameters
default_2 = SetDefault(Input=r2, Default="12")
cir_2 = Circle(Plane=divide.Points, Radius=default_2)
crv = Curve(cir_2)
cc = Curve(crv)  # sadfsadf
